# Dynamo graph MEP-Diffusors_in.dyn (Dynamo 0.8.2.2392)

categories = Categories("DuctTerminal")
all_elements_of_category = ElementsOfCategory(categories)
string = StringInput("ALG_Mounted")
file_path = Filename("C:\Daten-Arbeit\Eigene\_Seminare_Anleitungen\2015_AU\Dynamo\Diffusors_mounted.xlsx")
fromPath = FileObject(file_path)  # "File.FromPath"
string_2 = StringInput("Auslässe")
readFromFile = Excel.ReadFromFile(file=fromPath, sheetName=string_2)
watch = Watch(readFromFile)
transpose = List.Transpose(watch)
number = DoubleInput(1)
getItemAtIndex = List.GetItemAtIndex(list=transpose, index=number)
watch_2 = Watch(getItemAtIndex)
setParameterByName = Element.SetParameterByName(element=all_elements_of_category, parameterName=string, value=watch_2)
