# Dynamo graph MEP-Diffusors_out.dyn (Dynamo 0.8.2.2392)

file_path = Filename("C:\Daten-Arbeit\Eigene\_Seminare_Anleitungen\2015_AU\Dynamo\Diffusors_mounted.xlsx")
string = StringInput("Auslässe")
number = DoubleInput(0)
number_2 = DoubleInput(0)
categories = Categories("DuctTerminal")
all_elements_of_category = ElementsOfCategory(categories)
string_2 = StringInput("Kennzeichen")
getParameterValueByName = Element.GetParameterValueByName(element=all_elements_of_category, parameterName=string_2)
watch = Watch(getParameterValueByName)
string_3 = StringInput("ALG_Mounted")
getParameterValueByName_2 = Element.GetParameterValueByName(element=all_elements_of_category, parameterName=string_3)
watch_2 = Watch(getParameterValueByName_2)
create = List.Create(watch, watch_2)
watch_3 = Watch(create)
transpose = List.Transpose(watch_3)
watch_4 = Watch(transpose)
writeToFile = Excel.WriteToFile(filePath=file_path, sheetName=string, startRow=number, startCol=number_2, data=watch_4)
watch_5 = Watch(all_elements_of_category)
