# Dynamo graph AddLevelForDucts.dyn (Dynamo 0.8.2.2392)

categories = Categories("DuctCurves")
all_elements_of_category = ElementsOfCategory(categories)
watch = Watch(all_elements_of_category)
code_block = CodeBlock { "Referenzebene"; "ALG_Level"; }
getParameterValueByName = Element.GetParameterValueByName(element=all_elements_of_category, parameterName=code_block.out0)
watch_2 = Watch(getParameterValueByName)
name = Level.Name(getParameterValueByName)
setParameterByName = Element.SetParameterByName(element=all_elements_of_category, parameterName=code_block.out1, value=name)
