# Dynamo graph MEP-Spaces.dyn (Dynamo 0.9.1.4062)

categories = Categories("MEPSpaces")
all_elements_of_category = ElementsOfCategory(categories)
watch = Watch(all_elements_of_category)
code_block = CodeBlock { "RLT_Raum_Luftwechsel"; "Volumen"; "Angegebener Zuluftstrom"; }
getParameterValueByName = Element.GetParameterValueByName(element=all_elements_of_category, parameterName=code_block.out0)
watch_2 = Watch(getParameterValueByName)
getParameterValueByName_2 = Element.GetParameterValueByName(element=all_elements_of_category, parameterName=code_block.out1)
convert_internal_rme_airflow_to = Custom[Convert internal RME airflow to m3_h](volume=getParameterValueByName_2, change_rate=getParameterValueByName)  # Convert internal RME airflow to m3/h
setParameterByName = Element.SetParameterByName(element=all_elements_of_category, parameterName=code_block.out2, value=convert_internal_rme_airflow_to)
watch_3 = Watch(getParameterValueByName_2)
watch_4 = Watch(convert_internal_rme_airflow_to)
