# Dynamo graph MEP-Spaces.dyn (Dynamo 0.8.1.1942)

categories = Categories("MEPSpaces")
all_elements_of_category = ElementsOfCategory(categories)
watch = Watch(all_elements_of_category)
string = StringInput("RLT_Raum_Luftwechsel")
getParameterValueByName = Element.GetParameterValueByName(element=all_elements_of_category, parameterName=string)
watch_2 = Watch(getParameterValueByName)
string_2 = StringInput("Angegebener Zuluftstrom")
getParameterValueByName_2 = Element.GetParameterValueByName(element=all_elements_of_category, parameterName=string_2)
watch_3 = Watch(getParameterValueByName_2)
string_3 = StringInput("Volumen")
getParameterValueByName_3 = Element.GetParameterValueByName(element=all_elements_of_category, parameterName=string_3)
code_block = CodeBlock()
# ---------- code_block.designscript (5 lines) ----------
//
0.0923333333333333;
1;
0.00028316;
0.010170624015789;
# ----------------------------------------
formula = Formula("(volume *change_rate)*Conversion", volume=getParameterValueByName_3, change_rate=getParameterValueByName, Conversion=code_block.out2)
setParameterByName = Element.SetParameterByName(element=all_elements_of_category, parameterName=string_2, value=formula)
watch_4 = Watch(getParameterValueByName_3)
code_block_2 = CodeBlock { 4; }
round = Math.Round(number=formula, digits=code_block_2)
watch_5 = Watch(formula)
round_2 = Math.Round(formula)
