# Dynamo graph RME_AddLevelInfo.dyn (Dynamo 0.8.1.1942)

# group: Target parameter
string = StringInput("ALG_Ebene")

# group: Source parameter names
string_2 = StringInput("Referenzebene")
string_3 = StringInput("Ebene")

# group: Pipes
categories = Categories("PipeCurves")
all_elements_of_category = ElementsOfCategory(categories)
getParameterValueByName = Element.GetParameterValueByName(element=all_elements_of_category, parameterName=string_2)
name = Level.Name(getParameterValueByName)
setParameterByName = Element.SetParameterByName(element=all_elements_of_category, parameterName=string, value=name)

# group: pipefittings
categories_2 = Categories("PipeFitting")
all_elements_of_category_2 = ElementsOfCategory(categories_2)
getParameterValueByName_2 = Element.GetParameterValueByName(element=all_elements_of_category_2, parameterName=string_3)
name_2 = Level.Name(getParameterValueByName_2)
setParameterByName_2 = Element.SetParameterByName(element=all_elements_of_category_2, parameterName=string, value=name_2)

# group: Ducts
categories_3 = Categories("DuctCurves")
all_elements_of_category_3 = ElementsOfCategory(categories_3)
getParameterValueByName_3 = Element.GetParameterValueByName(element=all_elements_of_category_3, parameterName=string_2)
name_3 = Level.Name(getParameterValueByName_3)
setParameterByName_3 = Element.SetParameterByName(element=all_elements_of_category_3, parameterName=string, value=name_3)

# group: Ductfittings
categories_4 = Categories("DuctFitting")
all_elements_of_category_4 = ElementsOfCategory(categories_4)
getParameterValueByName_4 = Element.GetParameterValueByName(element=all_elements_of_category_4, parameterName=string_3)
name_4 = Level.Name(getParameterValueByName_4)
setParameterByName_4 = Element.SetParameterByName(element=all_elements_of_category_4, parameterName=string, value=name_4)

# group: pipeaccessory
categories_5 = Categories("PipeAccessory")
all_elements_of_category_5 = ElementsOfCategory(categories_5)
getParameterValueByName_5 = Element.GetParameterValueByName(element=all_elements_of_category_5, parameterName=string_3)
name_5 = Level.Name(getParameterValueByName_5)
setParameterByName_5 = Element.SetParameterByName(element=all_elements_of_category_5, parameterName=string, value=name_5)

# group: Ductaccessory
categories_6 = Categories("DuctAccessory")
all_elements_of_category_6 = ElementsOfCategory(categories_6)
getParameterValueByName_6 = Element.GetParameterValueByName(element=all_elements_of_category_6, parameterName=string_3)
name_6 = Level.Name(getParameterValueByName_6)
setParameterByName_6 = Element.SetParameterByName(element=all_elements_of_category_6, parameterName=string, value=name_6)
