# Dynamo graph RME_AirTerminals_Flow.dyn (Dynamo 0.9.1.4062)

string = StringInput("Volumenstrom")
setParameterByName = Element.SetParameterByName(parameterName=string)
getAllSpaces = Custom[GetAllSpaces]()  # Retrieves all spaces from model
geometry = Element.Geometry(getAllSpaces)
flatten = Flatten(geometry)
getAllTerminals = Custom[GetAllTerminals]()  # Retrieves all terminals from model
location = FamilyInstance.Location(getAllTerminals, lacing=Longest)
doesIntersect = Geometry.DoesIntersect(geometry=flatten, other=location, lacing=CrossProduct)
filterByBoolMask = List.FilterByBoolMask(list=getAllTerminals)
map = List.Map(list=doesIntersect, f_x=filterByBoolMask.in)
code_block = CodeBlock { "RLT_Raum_Luftwechsel"; "Luftwechselrate"; "Volumen"; }
getParameterValueByName = Element.GetParameterValueByName(element=getAllSpaces, parameterName=code_block.out2, lacing=Longest)
getParameterValueByName_2 = Element.GetParameterValueByName(element=getAllSpaces, parameterName=code_block.out0, lacing=Longest)
convert_internal_rme_airflow_to = Custom[Convert internal RME airflow to m3_h](volume=getParameterValueByName, change_rate=getParameterValueByName_2)  # Convert internal RME airflow to m3/h
countTrue = CountTrue(doesIntersect, lacing=Longest)
code_block_2 = CodeBlock(SpaceSpecifiedAirflow=convert_internal_rme_airflow_to, AirTerminalsperSpace=countTrue) { Ave=SpaceSpecifiedAirflow/AirTerminalsperSpace; }
laceLongest = List.LaceLongest(setParameterByName, map, code_block_2)
watch = Watch(convert_internal_rme_airflow_to)
string_2 = StringInput("Angegebener Zuluftstrom")
setParameterByName_2 = Element.SetParameterByName(element=getAllSpaces, parameterName=string_2, value=convert_internal_rme_airflow_to)
