# Dynamo custom node RME_Convert internal RME airflow to m3_h.dyf "Convert internal RME airflow to m3_h" (Dynamo 0.9.1.4062)
# category: Convert.Airflow
# Convert internal RME airflow to m3/h

volume = Input()
change_rate = Input()
code_block = CodeBlock()
# ---------- code_block.designscript (2 lines) ----------
//Conversion Rate for internal units RME
101.940647731;
# ----------------------------------------
formula = Formula("(volume *change_rate)/Conversion", volume=volume, change_rate=change_rate, Conversion=code_block)
Output = Output(formula)  # ""
