# Dynamo graph RME_Excel_Diffusors_in.dyn (Dynamo 1.3.2.2480)

file_path = Filename("..\..\..\Eigene\Desktop\Airterminals.xlsx")
fromPath = FileObject(file_path)  # "File.FromPath"
string = StringInput("Auslässe")
readFromFile = Excel.ReadFromFile(file=fromPath, sheetName=string)
transpose = List.Transpose(readFromFile)
number = DoubleInput(1)
getItemAtIndex = List.GetItemAtIndex(list=transpose, index=number)
watch = Watch(getItemAtIndex)
watch_2 = Watch(readFromFile)
getAllTerminals = Custom[GetAllTerminals]()  # Retrieves all terminals from model
string_2 = StringInput("ALG_Mounted")
setParameterByName = Element.SetParameterByName(element=getAllTerminals, parameterName=string_2, value=getItemAtIndex)
