# Dynamo graph RME_Excel_Diffusors_out.dyn (Dynamo 1.3.2.2480)

file_path = Filename("..\..\..\Eigene\Desktop\Airterminals")
code_block = CodeBlock { "Auslässe"; 0; 1; false; }
getAllTerminals = Custom[GetAllTerminals]()  # Retrieves all terminals from model
code_block_2 = CodeBlock { "ALG_Mounted"; "Kennzeichen"; "Ebene"; }
getParameterValueByName = Element.GetParameterValueByName(element=getAllTerminals, parameterName=code_block_2.out1)
getParameterValueByName_2 = Element.GetParameterValueByName(element=getAllTerminals, parameterName=code_block_2.out0)
getParameterValueByName_3 = Element.GetParameterValueByName(element=getAllTerminals, parameterName=code_block_2.out2)
create = List.Create(getParameterValueByName, getParameterValueByName_2, getParameterValueByName_3)
transpose = List.Transpose(create)
writeToFile = Excel.WriteToFile(filePath=file_path, sheetName=code_block.out0, startRow=code_block.out2, startCol=code_block.out1, data=transpose, overWrite=code_block.out3)
watch = Watch(getParameterValueByName_2)
watch_2 = Watch(getParameterValueByName)
watch_3 = Watch(create)
watch_4 = Watch(transpose)
