# Dynamo custom node RME_GetAllDuctAccessory.dyf (Dynamo 0.9.1.4062)
# category: Selection

categories = Categories("DuctAccessory")
all_elements_of_category = ElementsOfCategory(categories)
Elements = Output(all_elements_of_category)
