# Dynamo custom node RME_GetAllPipefittings.dyf (Dynamo 0.9.1.4062)
# category: Selection
# Retrieves all terminals from model

categories = Categories("PipeFitting")
all_elements_of_category = ElementsOfCategory(categories)
Elements = Output(all_elements_of_category)
