# Dynamo custom node RME_GetAllPlumbingFixtures.dyf (Dynamo 0.9.1.4062)
# category: Selection

categories = Categories("PlumbingFixtures")
all_elements_of_category = ElementsOfCategory(categories)
Elements = Output(all_elements_of_category)
