# Dynamo custom node RME_GetAllSpaces.dyf "GetAllSpaces" (Dynamo 0.9.1.4062)
# category: Selection
# Retrieves all spaces from model

categories = Categories("MEPSpaces")
all_elements_of_category = ElementsOfCategory(categories)
Elements = Output(all_elements_of_category)
