# Dynamo custom node RME_GetAllTerminals.dyf "GetAllTerminals" (Dynamo 0.9.1.4062)
# category: Selection
# Retrieves all terminals from model

categories = Categories("DuctTerminal")
all_elements_of_category = ElementsOfCategory(categories)
Elements = Output(all_elements_of_category)
