# Dynamo graph RME_RoomBoundingOff.dyn (Dynamo 0.8.2.2392)

# group: Columns
categories = Categories("Columns")
all_elements_of_category = ElementsOfCategory(categories)
code_block = CodeBlock()
# ---------- code_block.designscript (2 lines) ----------
// english name for roombounding
"Room Bounding";
# ----------------------------------------
boolean = BoolSelector(false)
setParameterByName = Element.SetParameterByName(element=all_elements_of_category, parameterName=code_block, value=boolean)
watch = Watch(all_elements_of_category)
