# Dynamo graph RME_Room_Airflow.dyn (Dynamo 1.2.1.3083)

categories = Categories("MEPSpaces")
all_elements_of_category = ElementsOfCategory(categories)
code_block = CodeBlock { "Volumen"; "Angegebener Zuluftstrom"; "RLT_Raum_Luftwechsel"; }
getParameterValueByName = Element.GetParameterValueByName(element=all_elements_of_category, parameterName=code_block.out2)
getParameterValueByName_2 = Element.GetParameterValueByName(element=all_elements_of_category, parameterName=code_block.out0)
code_block_2 = CodeBlock()
# ---------- code_block_2.designscript (2 lines) ----------
//Conversion Rate for internal units RME
101.940647731;
# ----------------------------------------
formula = Formula("(LW*Vol)/factor", LW=getParameterValueByName, Vol=getParameterValueByName_2, factor=code_block_2)
setParameterByName = Element.SetParameterByName(element=all_elements_of_category, parameterName=code_block.out1, value=formula)
