# Dynamo graph RME_SIA_Room_Calculation_export.dyn (Dynamo 1.0.0.1180)

getAllSpaces = Custom[GetAllSpaces]()  # Retrieves all spaces from model
code_block = CodeBlock()
# ---------- code_block.designscript (20 lines) ----------
//spacename;
"Name";
//spacenumber
"Number";
"Area";
//input;
"CAL_SIA_Number_person";
"CAL_SIA_Category";
"CAL_SIA_Air_flow_riser";
"CAL_SIA_Extract_air_compensation";

//calc;
"CAL_SIA_Air_flow_area";
"CAL_SIA_Supply_air_result";
"CAL_SIA_Extract_air_result";
//calc;
"CAL_SIA_Air_flow_person";
//calc;
//calc;
"CAL_SIA_Air_flow";
# ----------------------------------------
getParameterValueByName = Element.GetParameterValueByName(element=getAllSpaces, parameterName=code_block.out6)
watch = Watch(getParameterValueByName)
file_path = Filename("D:\Daten_Arbeit\Extern\RAPP\data\20160616\SIA_airflow_example.xlsx")
code_block_2 = CodeBlock()
# ---------- code_block_2.designscript (8 lines) ----------
//name of sheet for export
"Export";
//startrow
0;
//start column
0;
//do we want to override the export in sheet?
true;
# ----------------------------------------
getParameterValueByName_2 = Element.GetParameterValueByName(element=getAllSpaces, parameterName=code_block.out0)
getParameterValueByName_3 = Element.GetParameterValueByName(element=getAllSpaces, parameterName=code_block.out1)
getParameterValueByName_4 = Element.GetParameterValueByName(element=getAllSpaces, parameterName=code_block.out2)
getParameterValueByName_5 = Element.GetParameterValueByName(element=getAllSpaces, parameterName=code_block.out3)
getParameterValueByName_6 = Element.GetParameterValueByName(element=getAllSpaces, parameterName=code_block.out4)
getParameterValueByName_7 = Element.GetParameterValueByName(element=getAllSpaces, parameterName=code_block.out5)
create = List.Create(getParameterValueByName_2, getParameterValueByName_3, getParameterValueByName_4, getParameterValueByName_5, getParameterValueByName_6, getParameterValueByName_7, getParameterValueByName)
transpose = List.Transpose(create)
writeToFile = Excel.WriteToFile(filePath=file_path, sheetName=code_block_2.out0, startRow=code_block_2.out1, startCol=code_block_2.out2, data=transpose, overWrite=code_block_2.out3)
