# Dynamo graph RME_SIA_Room_Calculation_import.dyn (Dynamo 1.0.0.1180)

getAllSpaces = Custom[GetAllSpaces]()  # Retrieves all spaces from model
code_block = CodeBlock()
# ---------- code_block.designscript (33 lines) ----------
//spacename;
"Name";
0;
//spacenumber
"Number";
1;
//input
"Area";
2;
//input;
"CAL_SIA_Category";
3;
//input;
"CAL_SIA_Air_flow_riser";
4;
//input;
"CAL_SIA_Extract_air_compensation";
5;
//input;
"CAL_SIA_Number_person";
6;
//calc;
"CAL_SIA_Air_flow_area";
8;
//calc;
"CAL_SIA_Air_flow_person";
9;
//calc;
"CAL_SIA_Supply_air_result";
10;
//calc;
"CAL_SIA_Extract_air_result";
11;
# ----------------------------------------
file_path = Filename("..\..\..\..\..\Extern\RAPP\data\20160616\SIA_airflow_export.xlsx")
fromPath = FileObject(file_path)  # "File.FromPath"
code_block_2 = CodeBlock()
# ---------- code_block_2.designscript (8 lines) ----------
//name of sheet for export
"Import";
//startrow
3;
//start column
0;
//do we want to override the export in sheet?
true;
# ----------------------------------------
readFromFile = Excel.ReadFromFile(file=fromPath, sheetName=code_block_2.out0)
transpose = List.Transpose(readFromFile)

# group: CAL_SIA_Supply_air_result
getItemAtIndex = List.GetItemAtIndex(list=transpose, index=code_block.out19)
setParameterByName = Element.SetParameterByName(element=getAllSpaces, parameterName=code_block.out18, value=getItemAtIndex)

# group: CAL_SIA_Extract_air_result
getItemAtIndex_2 = List.GetItemAtIndex(list=transpose, index=code_block.out21)
setParameterByName_2 = Element.SetParameterByName(element=getAllSpaces, parameterName=code_block.out20, value=getItemAtIndex_2)
