# Dynamo graph RME_SizePipingInsulation.dyn (Dynamo 0.9.1.4062)

RME_GetAllPipefittings = Custom[RME_GetAllPipefittings]()  # Retrieves all terminals from model
string = StringInput("ALG_Wartungsraum_Sichtbar")
code_block = CodeBlock { 1; 0; }
setParameterByName = Element.SetParameterByName(element=RME_GetAllPipefittings, parameterName=string, value=code_block.out0)
watch = Watch(setParameterByName)
RME_GetAllPipes = Custom[RME_GetAllPipes]()  # Retrieves all terminals from model
create = List.Create(RME_GetAllPipes)
watch_2 = Watch(RME_GetAllPipes)
watch_3 = Watch(RME_GetAllPipefittings)
