# Dynamo graph RME_Toggle_MaintenanceSpace_Off.dyn (Dynamo 0.9.1.4062)

getAllDuctAccessory = Custom[GetAllDuctAccessory]()
RME_GetAllPlumbingFixtures = Custom[RME_GetAllPlumbingFixtures]()
create = List.Create(getAllDuctAccessory, RME_GetAllPlumbingFixtures)
string = StringInput("ALG_Wartungsraum_Sichtbar")
code_block = CodeBlock { 1; 0; }
setParameterByName = Element.SetParameterByName(element=create, parameterName=string, value=code_block.out1)
watch = Watch(setParameterByName)
