# Dynamo graph RME_Toggle_MountingSpace_Off.dyn (Dynamo 0.9.1.4062)

RME_GetAllPlumbingFixtures = Custom[RME_GetAllPlumbingFixtures]()
RME_GetAllDuctAccessory = Custom[RME_GetAllDuctAccessory]()
create = List.Create(RME_GetAllPlumbingFixtures, RME_GetAllDuctAccessory)
string = StringInput("ALG_Montageraum_Sichtbar")
code_block = CodeBlock { 1; 0; }
setParameterByName = Element.SetParameterByName(element=create, parameterName=string, value=code_block.out1)
watch = Watch(setParameterByName)
