# Dynamo graph 01_MEP Räume erstellen.dyn (Dynamo 1.2.1.3083)

# group: Auslesen der Räume aus der verlinkten Datei
get_documents = Custom[Get Documents]()  # Queries all linked Revit files and retrieves their Name, LinkInstance and Document properties.
categories = Categories("Rooms")
getFromLinkedFile = Custom[Element.GetFromLinkedFile](Link_Instance=get_documents.Link_Instance, Link_Document=get_documents.Link_Doc, Category=categories)  # Get elements from link document instance based on category

# group: Erstellung der MEP-Räume basierend auf der Lage der Architekturräume
location = Room.Location(getFromLinkedFile)
byPoint = Space.ByPoint(location)

# group: Aulesen bestimmter Eigenschaften aus den Architekturräumen, die auf die MEP-Räume übertragen werden sollen
code_block = CodeBlock { "Name"; "Nummer"; }
getParameterValueByName = Element.GetParameterValueByName(element=getFromLinkedFile, parameterName=code_block.out0)
getParameterValueByName_2 = Element.GetParameterValueByName(element=getFromLinkedFile, parameterName=code_block.out1)

# group: Übertragung der Eigenschaften auf die MEP-Räumen
setParameterByName = Element.SetParameterByName(element=byPoint, parameterName=code_block.out0, value=getParameterValueByName)
setParameterByName_2 = Element.SetParameterByName(element=byPoint, parameterName=code_block.out1, value=getParameterValueByName_2)
