# Dynamo graph 02_Excel Export.dyn (Dynamo 1.2.1.3083)

# group: Auswahl der MEP-Räume aus dem Modell
categories = Categories("MEPSpaces")
all_elements_of_category = ElementsOfCategory(categories)

# group: Ermittlung der Element-IDs, um die spätere Zuordnung zu den Bauteilen in Revit zu gewährleisten
uniqueId = Element.UniqueId(all_elements_of_category)

# group: Ermittlung der gewünschten Eigenschaften
code_block = CodeBlock { "Name"; "Nummer"; "Luftwechselrate"; }
getParameterValueByName = Element.GetParameterValueByName(element=all_elements_of_category, parameterName=code_block.out0)
getParameterValueByName_2 = Element.GetParameterValueByName(element=all_elements_of_category, parameterName=code_block.out1)
getParameterValueByName_3 = Element.GetParameterValueByName(element=all_elements_of_category, parameterName=code_block.out2)

# group: Zusammenfügen aller Eigenschaften zu einer Liste und Vorbereitung für den Export nach Excel
create = List.Create(uniqueId, getParameterValueByName, getParameterValueByName_2, getParameterValueByName_3)
transpose = List.Transpose(create)

# group: Export
file_path = Filename(".\Raumbuch.xlsx")
code_block_2 = CodeBlock { "Tabelle1"; 1; 0; }
writeToFile = Excel.WriteToFile(filePath=file_path, sheetName=code_block_2.out0, startRow=code_block_2.out1, startCol=code_block_2.out2, data=transpose)
