# Dynamo graph 03_Excel Import.dyn (Dynamo 1.2.1.3083)

# group: Auslesen der Daten aus Excel
file_path = Filename(".\Raumbuch.xlsx")
fromPath = FileObject(file_path)  # "File.FromPath"
code_block = CodeBlock { "Tabelle1"; }
readFromFile = Excel.ReadFromFile(file=fromPath, sheetName=code_block)

# group: "Umdrehen" der Zeilen und Spalten (ist i.d.R. immer beim Ein- und Auslesen aus Excel nötig!)
transpose = List.Transpose(readFromFile)

code_block_2 = CodeBlock { 0; 3; }

# group: Auslesen der IDs und Ermittlung der zugehörigen Elemente
getItemAtIndex = List.GetItemAtIndex(list=transpose, index=code_block_2.out0)
restOfItems = List.RestOfItems(getItemAtIndex)
id_to_element = Custom[Id to Element](Id=restOfItems)  # Selects elements in a model from id input (ElementId, string, integer or GUID)

# group: Auslesen der Spalte Luftwechselrate
getItemAtIndex_2 = List.GetItemAtIndex(list=transpose, index=code_block_2.out1)
restOfItems_2 = List.RestOfItems(getItemAtIndex_2)

# group: Eintragen der Luftwechselrate in die Parameter der Räume
code_block_3 = CodeBlock { "Luftwechselrate"; }
setParameterByName = Element.SetParameterByName(element=id_to_element, parameterName=code_block_3, value=restOfItems_2)
