# Dynamo graph 04_Durchbrüche.dyn (Dynamo 1.2.1.3083)

# group: Elemente aus dem aktuellen Projekt
categories = Categories("DuctCurves")
all_elements_of_category = ElementsOfCategory(categories)

# group: Elemente aus der verlinkten Datei
get_documents = Custom[Get Documents]()  # Queries all linked Revit files and retrieves their Name, LinkInstance and Document properties.
categories_2 = Categories("Walls")
getFromLinkedFile = Custom[Element.GetFromLinkedFile](Link_Instance=get_documents.Link_Instance, Link_Document=get_documents.Link_Doc, Category=categories_2)  # Get elements from link document instance based on category

# group: Konvertierung in Dynamo Geometrie
geometry = Element.Geometry(all_elements_of_category)
geometry_2 = Element.Geometry(getFromLinkedFile)

# group: Ermittlung der Kollisionen
intersect = Geometry.Intersect(geometry=geometry, other=geometry_2, lacing=CrossProduct)
flatten = Flatten(intersect)

# group: Platzieren einfacher Geometrie in Revit
categories_3 = Categories("GenericModel")
code_block = CodeBlock { "Rot"; }
byName = Material.ByName(code_block)
code_block_2 = CodeBlock { "Kollision"; }
byGeometry = DirectShape.ByGeometry(geometry=flatten, category=categories_3, material=byName, name=code_block_2)
